# Grasshopper definition subterrain-fitmesh-sandbox.gh (Grasshopper 0.9.76)

centroid = Data(Point(21.25854992, 15.16993407, 0))

# ---- group: Inputs
tension = Slider(0.797, range=0..1)
offset = Slider(-0.511, range=-1..0)
floorheight = Slider(0.25, range=0..1)
boundarycrv = Curve(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)
mesh = Data(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)

# ---- group: for reference
polygon = Curve(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)

# ---- group: globals
centroid_2 = Data(centroid)
text_size = Data(".25")

# ----
gallery = ImageGallery(
    CycleDelay=30,
    Randomize=False,
    UseLocalImages=True,
    UseRemoteImages=True,
    RemoteUrl="E:\mydocs\dat\grasshopper\components\subterrain\data\fitmesh.jpg")
subterrain_fitmesh = SubterrainFitMesh(
    tension=tension,
    offset=offset,
    boundarycrv=boundarycrv,
    mesh=mesh,
    simulationtoggle=Toggle(False),
    floorheight=floorheight)  # -> mesh_5, cornerpts_2, meshedges_2, meshvertices_2, boundarycrv_4

# ---- group: Outputs
meshvertices = Data(subterrain_fitmesh.meshvertices_2)
boundarycrv_2 = Data(subterrain_fitmesh.boundarycrv_4)
meshedges = Data(subterrain_fitmesh.meshedges_2)
cornerpts = Data(subterrain_fitmesh.cornerpts_2)
mesh_2 = Data(subterrain_fitmesh.mesh_5)

# ----
cornerpts_2 = Data(cornerpts)
centroid_3 = Data(centroid_2)

vec2pt = Vector2Pt(PointA=centroid_3, PointB=cornerpts_2, Unitize=False)  # -> Vector, Length
text_size_2 = Data(text_size)
vdis = VectorDisplay(Anchor=centroid_3, Vector=vec2pt.Vector)
tag = TextTag3D(Location=cornerpts_2, Text=vec2pt.Vector, Size=text_size_2, Colour=RGB(0, 0, 0), Justification=7)

# ==== cluster SubterrainFitMesh
simulationtoggle = ClusterInput()
boundarycrv = ClusterInput()
floorheight = ClusterInput()
tension = ClusterInput()
offset = ClusterInput()
mesh = ClusterInput()

simulationtoggle_2 = Data(simulationtoggle)
boundarycrv_2 = Data(boundarycrv)
floorheight_2 = Number(floorheight)
tension_2 = Data(tension)
offset_2 = Data(offset)
mesh_2 = Mesh(mesh)

nv = NakedVertices(Mesh=mesh_2)  # -> ClothedIndex, NakedIndex, ClothedPts, NakedPts
offset_3 = Offset(Curve=boundarycrv_2, Distance=offset_2, Plane=PlaneXY(0, 0, 0), Corners=1)
springsfrommesh = SpringsFromMesh(M=mesh_2, stiffness=100, B=tension_2)
boundary = Curve(offset_3)
curvepull = CurvePull(Curve=boundary, Points=nv.NakedPts, Strength=1000)
timer = Timer(TimerInterval=20, Target=kangaroo)
kangaroo = KangarooPhysics(ForceObjects=flatten([springsfrommesh, curvepull]), Settings=null, Geometry=mesh_2, SimulationReset=simulationtoggle_2)  # -> Out, Iterations, ParticlesOut, GeometryOut
mesh_3 = Mesh(kangaroo.GeometryOut)

elevation = Data(floorheight_2)

Z = UnitZ(Factor=1)
amp = Amplitude(Vector=Z, Amplitude=elevation)
move = Move(Geometry=mesh_3, Motion=amp)  # -> Geometry, Transform

displaced_mesh = Data(move.Geometry)

meshcorners = MeshCorners(M=displaced_mesh, A=1e-05)
pline = PolyLine(Vertices=meshcorners, Closed=True)
points = PointList(Points=meshcorners)

nv_2 = NakedVertices(Mesh=displaced_mesh)  # -> ClothedIndex, NakedIndex, ClothedPts, NakedPts
wbvertices = VerticesComponent(Mesh=displaced_mesh, Weld=True)
wbedges = MeshEdges(Mesh=displaced_mesh)

meshedges = Data(wbedges)
meshvertices = Data(wbvertices)
cornerpts = Data(nv_2.NakedPts)

# ---- group: room shape
boundarycrv_3 = Data(pline)

# ---- group: Cell Floor
mesh_4 = Data(move.Geometry)

# ----
mesh_5 = ClusterOutput(mesh_4)
meshedges_2 = ClusterOutput(meshedges)
cornerpts_2 = ClusterOutput(cornerpts)
meshvertices_2 = ClusterOutput(meshvertices)
boundarycrv_4 = ClusterOutput(boundarycrv_3)

# ==== cluster MeshCorners: Finds the corners of the boundary of a mesh
M = ClusterInput()
medges = MeshEdges(Mesh=M)  # -> NakedEdges, InteriorEdges, NonManifoldEdges
join = JoinCurves(Curves=medges.NakedEdges, Preserve=False)
explode = Explode(Curve=join, Recursive=True)  # -> simplify(Segments), Vertices
shift = ShiftList(List=explode.Segments, Shift=1, Wrap=True)  # -> simplify(List)
end = EndPoints(Curve=explode.Segments)  # -> Start, End
angle = Angle(VectorA=explode.Segments, VectorB=shift)  # -> Angle, Reflex
A = ClusterInput()
smaller = SmallerThan(FirstNumber=A, SecondNumber=angle.Angle)  # -> SmallerThan, OrEqualTo
cull = CullPattern(List=end.End, CullPattern=smaller.SmallerThan)  # -> flatten(List)
L = ClusterOutput(cull)

# ==== cluster SpringsFromMesh: Turns all edges of a mesh into springs
M = ClusterInput()
medges = MeshEdges(Mesh=M)  # -> NakedEdges, InteriorEdges, NonManifoldEdges
crv = Curve([medges.NakedEdges, medges.InteriorEdges])
B = ClusterInput()
len = Length(Curve=crv)
multiplication = Multiplication(A=len, B=B)
stiffness = ClusterInput()
springs = SpringsFromLine(Connection=crv, Stiffness=stiffness, Damping=10, RestLength=multiplication, UpperCutoff=0, LowerCutoff=0, Plasticity=0)
S = ClusterOutput(springs)
