# Grasshopper definition subterrain-inflate-sandbox.gh (Grasshopper 0.9.76)
# plug-ins: Kangaroo Components, TSplinesGH

gallery = ImageGallery(
    CycleDelay=30,
    Randomize=False,
    UseLocalImages=True,
    UseRemoteImages=True,
    RemoteUrl="E:\mydocs\dat\grasshopper\components\subterrain\data\inflate.jpg")

pts_to_pull_to_crv = Point([<point referenced from the Rhino model> x9])

pts_to_pull_to_crv_2 = Point([<point referenced from the Rhino model> x9])

manual_section = Curve()
curvepull = CurvePull(Curve=manual_section, Points=pts_to_pull_to_crv_2, Strength=Slider(200, range=0..1000))

cat = Catenary(
    PointA=<geometry referenced from the Rhino model>,
    PointB=<geometry referenced from the Rhino model>,
    Length=Slider(5.527, range=0..10),
    Gravity=Vector(0, 0, 5.506078695))
curvepull_2 = CurvePull(Curve=cat, Points=pts_to_pull_to_crv, Strength=Slider(200, range=0..1000))

mesh_corners = Data([Point(21.35190964, 20.47545433, 0.25), Point(18.8192234, 19.73668289, 0.25), Point(25.68869209, 15.63915157, 0.25), Point(24.4865303, 18.44423676, 0.25), Point(23.10089493, 10.3830719, 0.25), Point(24.80140686, 12.44283676, 0.25)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])
selected_pts = Point()
anchor_pts = Point(mesh_corners)

curvepulls = Data([curvepull_2, curvepull])

# ---- group: Inputs
distributedload = Slider(128.42, range=0..1000)
vertical_stretch = Slider(1.8, range=0..3)
meshvertices = Data([Point(20.471035, 18.56698418, 0.25), Point(23.90576744, 16.51821899, 0.25), Point(23.21295166, 12.48763657, 0.25), Point(20.21110344, 11.62002373, 0.25), Point(18.43193245, 14.92345428, 0.25), Point(19.52082253, 16.70186615, 0.25)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])
meshedges = Data([Line((19.52082253, 16.70186615, 0.25), (17.98525238, 18.09309006, 0.25)), Line((20.471035, 18.56698418, 0.25), (19.52082253, 16.70186615, 0.25)), Line((20.471035, 18.56698418, 0.25), (18.8192234, 19.73668289, 0.25)), Line((18.8192234, 19.73668289, 0.25), (17.98525238, 18.09309006, 0.25)), Line((19.52082253, 16.70186615, 0.25), (21.25258064, 15.00749397, 0.25)), Line((22.15562248, 17.469944, 0.25), (21.25258064, 15.00749397, 0.25))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])
anchor_pts_2 = Point(anchor_pts)
curvepulls_2 = Data()
mesh = Data(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)

# ----
gallery_2 = ImageGallery(
    CycleDelay=30,
    Randomize=False,
    UseLocalImages=True,
    UseRemoteImages=True,
    RemoteUrl="E:\mydocs\dat\grasshopper\components\subterrain\data\mass.jpg")
subterrain_inflate = SubterrainInflate(
    mesh=mesh,
    meshedges=meshedges,
    meshvertices=meshvertices,
    anchorpts=anchor_pts_2,
    curvepulls=curvepulls_2,
    distributedload=distributedload,
    simulationtoggle=Toggle(False),
    verticalstretch=vertical_stretch,
    bottommesh=mesh)  # -> mesh_4, meshcorners_2, meshedges_4, meshvertices_4, closedmesh_2

# ---- group: Outputs
closedmesh = Data(subterrain_inflate.closedmesh_2)
meshvertices_2 = Data(subterrain_inflate.meshvertices_4)
meshcorners = Data(subterrain_inflate.meshcorners_2)
meshedges_2 = Data(subterrain_inflate.meshedges_4)
mesh_2 = Data(subterrain_inflate.mesh_4)

# ----
tsdrawidx = TsDrawIndexes(InTSpline=closedmesh, Grip=False, Vert=True, Edge=True, Face=True, Link=False)  # disabled

relaxed_vertices = Data(meshvertices_2)
centroid = Data(Point(21.25854992, 15.16993407, 0))

vec2pt = Vector2Pt(PointA=centroid, PointB=relaxed_vertices, Unitize=False)  # -> Vector, Length
tag = TextTag3D(Location=relaxed_vertices, Text=vec2pt.Vector, Size=".1", Justification=7)

# ==== cluster SubterrainInflate
distributedload = ClusterInput()
simulationtoggle = ClusterInput()
bottommesh = ClusterInput()
verticalstretch = ClusterInput()
meshvertices = ClusterInput()
meshedges = ClusterInput()
curvepulls = ClusterInput()
anchorpts = ClusterInput()
mesh = ClusterInput()

distributedload_2 = Data(distributedload)
simulationtoggle_2 = Data(simulationtoggle)
bottommesh_2 = Data(bottommesh)
verticalstretch_2 = Number(verticalstretch)
curvepulls_2 = Data(curvepulls)
anchorpts_2 = Point(anchorpts)

meshvertices_2 = Data(meshvertices)
meshedges_2 = Data(meshedges)
mesh_2 = Mesh(mesh)

Z = UnitZ(Factor=distributedload_2)
springs = SpringsFromLine(
    Connection=meshedges_2,
    Stiffness=1000,
    Damping=10,
    RestLength=meshedges_2,
    Cutoff=0,
    CompressionFail=0,
    TensileFail=0,
    Plasticity=0)
uforce = UnaryForce(Point=meshvertices_2, Force=Z)
timer = Timer(TimerInterval=1000, Target=kangaroo)
kangaroo = KangarooPhysics(
    ForceObjects=flatten([springs, curvepulls_2, uforce]),
    AnchorPoints=anchorpts_2,
    Settings=null,
    Geometry=mesh_2,
    SimulationReset=simulationtoggle_2)  # -> Out, Iterations, ParticlesOut, GeometryOut
relaxed_mesh = Mesh(kangaroo.GeometryOut)

bottom_mesh = Data(bottommesh_2)

vertical_stretch = Data(verticalstretch_2)

Z_2 = UnitZ(Factor=1)
amp = Amplitude(Vector=Z_2, Amplitude=vertical_stretch)
move = Move(Geometry=kangaroo.GeometryOut, Motion=amp)  # -> Geometry, Transform

displaced_mesh = Data(move.Geometry)

nv = NakedVertices(Mesh=displaced_mesh)  # -> ClothedIndex, NakedIndex, ClothedPts, NakedPts
wbvertices = VerticesComponent(Mesh=displaced_mesh, Weld=True)
wbedges = MeshEdges(Mesh=displaced_mesh)

meshvertices_3 = Data(wbvertices)
meshcorners = Data(nv.NakedPts)
meshedges_3 = Data(wbedges)

# ---- group: Cell Top
mesh_3 = Data(move.Geometry)

# ----
top_mesh = Data(mesh_3)

tsconv = TsConvert(InGeometry=top_mesh)
tsconv_2 = TsConvert(InGeometry=bottom_mesh)
tsdedge = TsDecomposeEdge(InTSpline=tsconv)  # -> OutputAll, OutputNonmanifold, OutputBorder, OutputInner
tsdedge_2 = TsDecomposeEdge(InTSpline=tsconv_2)  # -> OutputAll, OutputNonmanifold, OutputBorder, OutputInner
tsbridge = TsBridge(
    InTSpline0=tsconv,
    Edges0=tsdedge.OutputBorder,
    InTSpline1=tsconv_2,
    Edges1=tsdedge_2.OutputBorder,
    InCurve=<geometry referenced from the Rhino model>,
    Segs=3)

closedmesh = Data(tsbridge)

mesh_4 = ClusterOutput(mesh_3)
meshedges_4 = ClusterOutput(meshedges_3)
meshcorners_2 = ClusterOutput(meshcorners)
meshvertices_4 = ClusterOutput(meshvertices_3)
closedmesh_2 = ClusterOutput(closedmesh)
