# Grasshopper definition subterrain-init-sandbox.gh (Grasshopper 0.9.76)

workpoint = Point(<point referenced from the Rhino model>)
polygon = Curve(<curve referenced from the Rhino model>)

# ---- group: globals
workpoint_2 = Data(workpoint)
text_size = Data(".25")

# ---- group: input
polygon_2 = Data(polygon)

# ----
gallery = ImageGallery(CycleDelay=30, Randomize=False, UseLocalImages=True, UseRemoteImages=True)
subterrain_init = SubterrainInit(polygon=polygon_2)  # -> centroid_4, corners_3, midpts_3, rp2cp_2, rp2mp_2

centroid = Data(subterrain_init.centroid_4)
corners = Data(subterrain_init.corners_3)

corners_2 = Data(corners)
lng = ListLength(List=corners_2)
series = Series(Start=0, Step=1, Count=lng)
workpoint_3 = Point(workpoint_2)
int = Integer(series)
text_size_2 = Data(text_size)
concat = Concatenate(FragmentA="CP", FragmentB=int)
text_size_3 = Data(text_size)
tag = TextTag3D(Location=workpoint_3, Text="RP01", Size=text_size_2, Justification=7)
tag_2 = TextTag3D(Location=corners_2, Text=concat, Size=text_size_3, Justification=7)

# ---- group: label RP
workpoint_4 = Point(workpoint_2)
centroid_2 = Data(centroid)
vec2pt = Vector2Pt(PointA=workpoint_4, PointB=centroid_2, Unitize=False)  # -> Vector, Length
text_size_4 = Data(text_size)
tag_3 = TextTag3D(Location=centroid_2, Text=vec2pt.Vector, Size=text_size_4, Justification=7)
vdis = VectorDisplay(Anchor=workpoint_4, Vector=vec2pt.Vector)

# ----
workpoint_5 = Point(workpoint_2)
text_size_5 = Data(text_size)
tag_4 = TextTag3D(Location=workpoint_5, Text="WP", Size=text_size_5, Justification=7)

# ==== cluster SubterrainInit
polygon = ClusterInput()
polygon_2 = Curve(polygon)

explode = Explode(Curve=polygon_2, Recursive=True)  # -> Segments, Vertices
len = Length(Curve=explode.Segments)
division = Division(A=len, B=2)
eval = EvaluateCurve(Curve=explode.Segments, Parameter=division)  # -> Point, Tangent, Angle

cp = ControlPoints(Curve=polygon_2)  # -> Points, Weights, Knots
pcen = PolygonCenter(Polyline=polygon_2)  # -> CenterV, CenterE, CenterA
cull_i = CullIndex(List=cp.Points, Indices=0, Wrap=True)

segments = Data(explode.Segments)

centroid = Data(pcen.CenterA)
corners = Data(cull_i)
midpts = Data(eval.Point)

centroid_2 = Data(centroid)
centroid_3 = Data(centroid)
corners_2 = Data(corners)
midpts_2 = Data(midpts)
vec2pt = Vector2Pt(PointA=centroid_3, PointB=midpts_2, Unitize=False)  # -> Vector, Length
vec2pt_2 = Vector2Pt(PointA=centroid_2, PointB=corners_2, Unitize=False)  # -> Vector, Length

rp2cp = Data(vec2pt_2.Vector)
rp2mp = Data(vec2pt.Vector)

midpts_3 = ClusterOutput(midpts)
corners_3 = ClusterOutput(corners)
centroid_4 = ClusterOutput(centroid)
rp2cp_2 = ClusterOutput(rp2cp)
rp2mp_2 = ClusterOutput(rp2mp)
