# Grasshopper definition subterrain-makemesh-sandbox.gh (Grasshopper 0.9.76)

# ---- group: Inputs
subdivisions = Slider(3, range=0..4)
mode_topology = Slider(7, range=0..11)

# ----
gallery = ImageGallery(CycleDelay=30, Randomize=False, UseLocalImages=True, UseRemoteImages=True)

# ---- group: globals
text_size = Data(".25")

# ---- group: Inputs
override_mesh = Geometry(<mesh referenced from the Rhino model>)

centroid = Data(Point(21.25854992, 15.16993407, 0))
polygon = Data(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)
corners = Data([Point(19.71667755, 21.32627358, 0), Point(25.98591718, 17.26383671, 0), Point(24.21134955, 10.87120741, 0), Point(19.68274171, 9.574316086, 0), Point(16.63472278, 14.53588046, 0)])
midpts = Data([Point(17.92177085, 18.14709485, 0), Point(22.98713978, 19.62463636, 0), Point(25.39146593, 14.0144672, 0), Point(21.99043971, 9.894936367, 0), Point(17.91268136, 11.84090726, 0)])

# ----
subterrain_makemesh = SubterrainMakeMesh(mode=mode_topology, polygon=polygon, corners=corners, midpts=midpts, centroid=centroid, subdivlevel=subdivisions)  # -> mesh_2, meshedges_2, meshvertices_2, cornerspts_2, boundarycrv_2

# ---- group: Outputs
meshvertices = Data(subterrain_makemesh.meshvertices_2)
boundarycrv = Curve(subterrain_makemesh.boundarycrv_2)
meshedges = Data(subterrain_makemesh.meshedges_2)
cornerpts = Data(subterrain_makemesh.cornerspts_2)
mesh = Data(subterrain_makemesh.mesh_2)

# ----
text_size_2 = Data(text_size)
points = PointList(Points=cornerpts, Size=text_size_2)

# ==== cluster SubterrainMakeMesh
polygon = ClusterInput()
subdivlevel = ClusterInput()
centroid = ClusterInput()
overridemesh = ClusterInput()
corners = ClusterInput()
midpts = ClusterInput()
mode = ClusterInput()

polygon_2 = Data(polygon)
subdivlevel_2 = Data(subdivlevel)
centroid_2 = Data(centroid)
corners_2 = Data(corners)
midpts_2 = Data(midpts)

overridemesh_2 = Data(overridemesh)
mode_2 = Data(mode)

weave = Weave(Pattern=[0, 1], Stream0=corners_2, Stream1=midpts_2, NullGaps=False)
ln = Line(StartPoint=weave, EndPoint=centroid_2)
explode = Explode(Curve=polygon_2, Recursive=True)  # -> Segments, Vertices
merge = Merge(Data1=flatten(explode.Segments), Data2=flatten(ln))
wbweave = WeaverbirdsMeshFromLinesWeaveBack(Lines=merge, MaximumValence=4)
wbcatmullclark = WeaverbirdsCatmullClarkSubdivision(MeshCurves=wbweave, Level=subdivlevel_2, SmoothNakedEdges=1)
wbloop = WeaverbirdsLoopSubdivision(MeshCurves=wbweave, Level=subdivlevel_2, SmoothNakedEdges=1)

ln_2 = Line(StartPoint=corners_2, EndPoint=centroid_2)
explode_2 = Explode(Curve=polygon_2, Recursive=True)  # -> Segments, Vertices
merge_2 = Merge(Data1=flatten(explode_2.Segments), Data2=flatten(ln_2))
wbweave_2 = WeaverbirdsMeshFromLinesWeaveBack(Lines=merge_2, MaximumValence=4)
wbcatmullclark_2 = WeaverbirdsCatmullClarkSubdivision(MeshCurves=wbweave_2, Level=subdivlevel_2, SmoothNakedEdges=1)
wbloop_2 = WeaverbirdsLoopSubdivision(MeshCurves=wbweave_2, Level=subdivlevel_2, SmoothNakedEdges=1)

ln_3 = Line(StartPoint=midpts_2, EndPoint=centroid_2)
explode_3 = Explode(Curve=polygon_2, Recursive=True)  # -> Segments, Vertices
merge_3 = Merge(Data1=flatten(explode_3.Segments), Data2=flatten(ln_3))
wbweave_3 = WeaverbirdsMeshFromLinesWeaveBack(Lines=merge_3, MaximumValence=4)
wbcatmullclark_3 = WeaverbirdsCatmullClarkSubdivision(MeshCurves=wbweave_3, Level=subdivlevel_2, SmoothNakedEdges=1)
wbloop_3 = WeaverbirdsLoopSubdivision(MeshCurves=wbweave_3, Level=subdivlevel_2, SmoothNakedEdges=1)

mjoin = MeshJoin(Meshes=overridemesh_2)
wbunify = WeaverbirdsUnifyFaceWindings(MeshCurves=mjoin)
wbcatmullclark_4 = WeaverbirdsCatmullClarkSubdivision(MeshCurves=wbunify, Level=subdivlevel_2, SmoothNakedEdges=1)
weld = WeldMesh(Mesh=mjoin, Angle=0)
wbloop_4 = WeaverbirdsLoopSubdivision(MeshCurves=wbunify, Level=subdivlevel_2, SmoothNakedEdges=1)

# ---- group: option 1
furthur_subdiv_quad_mesh = Data(wbcatmullclark_4)
furthur_subdiv_tri_mesh = Data(wbloop_4)
manual_mesh = Mesh(wbunify)

# ---- group: option 2
subdivided_quad_mesh = Data(wbcatmullclark)
subdivided_tri_mesh = Data(wbloop)
simple_mesh = Mesh(wbweave)

subdivided_quad_mesh_2 = Data(wbcatmullclark_2)
subdivided_tri_mesh_2 = Data(wbloop_2)
simple_mesh_2 = Mesh(wbweave_2)

subdivided_quad_mesh_3 = Data(wbcatmullclark_3)
subdivided_tri_mesh_3 = Data(wbloop_3)
simple_mesh_3 = Mesh(wbweave_3)

# ----
mode_3 = Data(mode_2)
p_n_c = PickNChoose(
    Pattern=mode_3,
    Stream0=manual_mesh,
    Stream1=furthur_subdiv_quad_mesh,
    Stream2=furthur_subdiv_tri_mesh,
    Stream3=simple_mesh,
    Stream4=subdivided_quad_mesh,
    Stream5=subdivided_tri_mesh,
    Stream6=simple_mesh_2,
    Stream7=subdivided_quad_mesh_2,
    Stream8=subdivided_tri_mesh_2,
    Stream9=simple_mesh_3,
    Stream10=subdivided_quad_mesh_3,
    Stream11=subdivided_tri_mesh_3)

flat_mesh = Data(p_n_c)

meshcorners = MeshCorners(M=flat_mesh, A=1e-05)
pline = PolyLine(Vertices=meshcorners, Closed=True)

nv = NakedVertices(Mesh=flat_mesh)  # -> ClothedIndex, NakedIndex, ClothedPts, NakedPts
wbvertices = VerticesComponent(Mesh=flat_mesh, Weld=True)
wbedges = MeshEdges(Mesh=flat_mesh)

# ---- group: room shape
boundarycrv = Data(pline)
cornerspts = Data(meshcorners)

# ---- group: topology
meshvertices = Data(wbvertices)
meshedges = Data(wbedges)

# ----
mesh = Mesh(p_n_c)

mesh_2 = ClusterOutput(mesh)
cornerspts_2 = ClusterOutput(cornerspts)
boundarycrv_2 = ClusterOutput(boundarycrv)
meshedges_2 = ClusterOutput(meshedges)
meshvertices_2 = ClusterOutput(meshvertices)

# ==== cluster MeshCorners: Finds the corners of the boundary of a mesh
M = ClusterInput()
medges = MeshEdges(Mesh=M)  # -> NakedEdges, InteriorEdges, NonManifoldEdges
join = JoinCurves(Curves=medges.NakedEdges, Preserve=False)
explode = Explode(Curve=join, Recursive=True)  # -> simplify(Segments), Vertices
shift = ShiftList(List=explode.Segments, Shift=1, Wrap=True)  # -> simplify(List)
end = EndPoints(Curve=explode.Segments)  # -> Start, End
angle = Angle(VectorA=explode.Segments, VectorB=shift)  # -> Angle, Reflex
A = ClusterInput()
smaller = SmallerThan(FirstNumber=A, SecondNumber=angle.Angle)  # -> SmallerThan, OrEqualTo
cull = CullPattern(List=end.End, CullPattern=smaller.SmallerThan)  # -> flatten(List)
L = ClusterOutput(cull)
