# Grasshopper definition subterrain-offset-sandbox.gh (Grasshopper 0.9.76)

mp_offsets = Slider(0.29, range=-1..1)
cp_offsets = Slider(0.95, range=0..1)

merge = Merge(Data1=cp_offsets, Data2=cp_offsets, Data3=cp_offsets, Data4=cp_offsets, Data5=cp_offsets)
merge_2 = Merge(Data1=mp_offsets, Data2=mp_offsets, Data3=mp_offsets, Data4=mp_offsets, Data5=mp_offsets)

# ---- group: globals
dimension_text_size = Data(".15")
text_size = Data(".25")

# ---- group: Input
corner_offset = Data(merge)
midpt_offset = Data(merge_2)
centroid = Data(Point(21.25854992, 15.16993407, 0))
corners = Data([Point(19.59520306, 21.81129312, 0), Point(26.37907651, 17.43797959, 0), Point(24.40385535, 10.59095481, 0), Point(19.57702408, 9.198917922, 0), Point(16.24833864, 14.48289659, 0)])
midpts = Data([Point(17.92177085, 18.14709485, 0), Point(22.98713978, 19.62463636, 0), Point(25.39146593, 14.0144672, 0), Point(21.99043971, 9.894936367, 0), Point(17.91268136, 11.84090726, 0)])
rp2cp = Data([Vector(-1.663346865, 6.641359046, 0), Vector(5.120526583, 2.268045522, 0), Vector(3.145305424, -4.578979259, 0), Vector(-1.681525846, -5.97101615, 0), Vector(-5.010211286, -0.68703748, 0)])
rp2mp = Data([Vector(-3.336779076, 2.977160783, 0), Vector(1.728589859, 4.454702284, 0), Vector(4.132916003, -1.155466869, 0), Vector(0.7318897889, -5.274997704, 0), Vector(-3.345868566, -3.329026815, 0)])

# ---- group: for reference
polygon = Curve(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)

# ----
subterrain_offset = SubterrainOffset(corners=corners, rp2cp=rp2cp, corneroffsets=corner_offset, midpts=midpts, rp2mp=rp2mp, midptoffsets=midpt_offset)  # -> corners_4, midpts_4, polygon_2
polygon_2 = Data(subterrain_offset.polygon_2)
gallery = ImageGallery(CycleDelay=30, Randomize=False, UseLocalImages=True, UseRemoteImages=True)

offsetcorners = Data(subterrain_offset.corners_4)
offsetmidpts = Data(subterrain_offset.midpts_4)
centroid_2 = Data(centroid)
corners_2 = Data(corners)
midpts_2 = Data(midpts)

offset_midpts = Data(offsetmidpts)

offset_corners = Data(offsetcorners)

offset_corners_2 = Data(offsetcorners)
centroid_3 = Data(centroid_2)

offset_corners_3 = Data(offsetcorners)
corners_3 = Data(corners_2)

offset_midpts_2 = Data(offsetmidpts)
midpts_3 = Data(midpts_2)

lng = ListLength(List=offset_midpts)
series = Series(Start=0, Step=1, Count=lng)
int = Integer(series)
concat = Concatenate(FragmentA="MP", FragmentB=int)
text_size_2 = Data(text_size)
tag = TextTag3D(Location=offset_midpts, Text=concat, Size=text_size_2, Justification=7)

lng_2 = ListLength(List=offset_corners)
series_2 = Series(Start=0, Step=1, Count=lng_2)
int_2 = Integer(series_2)
concat_2 = Concatenate(FragmentA="CP", FragmentB=int_2)
text_size_3 = Data(text_size)
tag_2 = TextTag3D(Location=offset_corners, Text=concat_2, Size=text_size_3, Justification=7)

dimension_text_size_2 = Data(dimension_text_size)
ln = Line(StartPoint=corners_3, EndPoint=offset_corners_3)
lineardim = LinearDimension(Line=ln, PointA=corners_3, PointB=offset_corners_3, Text="{0:0.00}", Size=dimension_text_size_2)

vec2pt = Vector2Pt(PointA=centroid_3, PointB=offset_corners_2, Unitize=False)  # -> Vector, Length
text_size_4 = Data(text_size)
tag_3 = TextTag3D(Location=offset_corners_2, Text=vec2pt.Vector, Size=text_size_4, Justification=7)
vdis = VectorDisplay(Anchor=centroid_3, Vector=vec2pt.Vector)

ln_2 = Line(StartPoint=midpts_3, EndPoint=offset_midpts_2)
dimension_text_size_3 = Data(dimension_text_size)
lineardim_2 = LinearDimension(Line=ln_2, PointA=midpts_3, PointB=offset_midpts_2, Text="{0:0.00}", Size=dimension_text_size_3)

# ==== cluster SubterrainOffset
midptoffsets = ClusterInput()
corneroffsets = ClusterInput()
corners = ClusterInput()
rp2cp = ClusterInput()
midpts = ClusterInput()
rp2mp = ClusterInput()

midptoffsets_2 = Data(midptoffsets)
corneroffsets_2 = Data(corneroffsets)
corners_2 = Data(corners)
rp2cp_2 = Data(rp2cp)
midpts_2 = Data(midpts)
rp2mp_2 = Data(rp2mp)

rev = Reverse(Vector=rp2cp_2)
amp = Amplitude(Vector=rev, Amplitude=corneroffsets_2)
move = Move(Geometry=corners_2, Motion=amp)  # -> Geometry, Transform

rev_2 = Reverse(Vector=rp2mp_2)
amp_2 = Amplitude(Vector=rev_2, Amplitude=midptoffsets_2)
move_2 = Move(Geometry=midpts_2, Motion=amp_2)  # -> Geometry, Transform

offset_corners = Data(move.Geometry)
offset_midpts = Data(move_2.Geometry)

weave = Weave(Pattern=[0, 1], Stream0=offset_midpts, Stream1=offset_corners, NullGaps=False)
pline = PolyLine(Vertices=weave, Closed=True)

corners_3 = Data(move.Geometry)
polygon = Data(pline)
midpts_3 = Data(move_2.Geometry)

midpts_4 = ClusterOutput(midpts_3)
corners_4 = ClusterOutput(corners_3)
polygon_2 = ClusterOutput(polygon)
