# Grasshopper definition subterrain-sandbox.gh (Grasshopper 0.9.76)
# plug-ins: Kangaroo Components

gallery = ImageGallery(CycleDelay=30, Randomize=False, UseLocalImages=True, UseRemoteImages=True)
gallery_2 = ImageGallery(
    CycleDelay=30,
    Randomize=False,
    UseLocalImages=True,
    UseRemoteImages=True,
    RemoteUrl="E:\mydocs\dat\grasshopper\components\subterrain\data\fitmesh.jpg")

pts_to_pull_to_crv = Point([<point referenced from the Rhino model> x9])
manual_section = Curve()
curvepull = CurvePull(Curve=manual_section, Points=pts_to_pull_to_crv, Strength=Slider(200, range=0..1000))

# ---- group: N01
cp0 = Slider(0.5, range=0..1)
cp1 = Slider(0.43, range=0..1)
cp2 = Slider(0.34, range=0..1)
cp3 = Slider(0.39, range=0..1)
cp4 = Slider(0.39, range=0..1)
cp5 = Slider(0.47, range=0..2)
cp6 = Slider(0.5, range=0..1)
mp1 = Slider(0.22, range=0..1)
mp0 = Slider(0, range=-1..1)
mp2 = Slider(0.26, range=0..1)
mp3 = Slider(0.2, range=0..1)
mp4 = Slider(0.2, range=0..1)
mp5 = Slider(0.24, range=0..1)
mp6 = Slider(0.22, range=0..1)

# ----
pts_to_pull_to_crv_2 = Point([<point referenced from the Rhino model> x9])
cat = Catenary(
    PointA=<geometry referenced from the Rhino model>,
    PointB=<geometry referenced from the Rhino model>,
    Length=Slider(5.527, range=0..10),
    Gravity=Vector(0, 0, 5.506078695))
curvepull_2 = CurvePull(Curve=cat, Points=pts_to_pull_to_crv_2, Strength=Slider(200, range=0..1000))

workpoint = Point(<point referenced from the Rhino model>)
merge = Merge(Data1=cp0, Data2=cp1, Data3=cp2, Data4=cp3, Data5=cp4)
merge_2 = Merge(Data1=mp0, Data2=mp0, Data3=mp0, Data4=mp0, Data5=mp0)

# ---- group: globals
workpoint_2 = Data(workpoint)
text_size = Data(".2")
dimension_text_size = Data(".15")
coordinate_text_size = Data(".1")

# ----
corner_offset = Data(merge)
midpt_offset = Data(merge_2)

curvepulls = Data()
gallery_3 = ImageGallery(CycleDelay=30, Randomize=False, UseLocalImages=True, UseRemoteImages=True)
polygon = Curve(<curve referenced from the Rhino model>)
subterrain_init = SubterrainInit(polygon=polygon)  # -> centroid_4, corners_3, midpts_3, rp2cp_2, rp2mp_2
gallery_4 = ImageGallery(
    CycleDelay=30,
    Randomize=False,
    UseLocalImages=True,
    UseRemoteImages=True,
    RemoteUrl="E:\mydocs\dat\grasshopper\components\subterrain\data\inflate.jpg")
text_size_2 = Data(coordinate_text_size)

corner_offset_2 = Data(corner_offset)
midpt_offset_2 = Data(midpt_offset)

subterrain_offset = SubterrainOffset(
    corners=subterrain_init.corners_3,
    midpts=subterrain_init.midpts_3,
    corneroffsets=corner_offset_2,
    midptoffsets=midpt_offset_2,
    rp2cp=subterrain_init.rp2cp_2,
    rp2mp=subterrain_init.rp2mp_2)  # -> corners_4, midpts_4, polygon_2

workpoint_3 = Point(workpoint_2)
centroid = Data(subterrain_init.centroid_4)
corners = Data(subterrain_init.corners_3)

corners_2 = Data(corners)
lng = ListLength(List=corners_2)
series = Series(Start=0, Step=1, Count=lng)
workpoint_4 = Point(workpoint_3)
int = Integer(series)
text_size_3 = Data(text_size)
concat = Concatenate(FragmentA="CP", FragmentB=int)
text_size_4 = Data(text_size)
tag = TextTag3D(Location=workpoint_4, Text="RP01", Size=text_size_3, Justification=7)
tag_2 = TextTag3D(Location=corners_2, Text=concat, Size=text_size_4, Justification=7)

subdivisions = Slider(2, range=0..4)
output = Slider(10, range=0..11)

# ---- group: label RP
workpoint_5 = Point(workpoint_3)
centroid_2 = Data(centroid)
vec2pt = Vector2Pt(PointA=workpoint_5, PointB=centroid_2, Unitize=False)  # -> Vector, Length
text_size_5 = Data(text_size)
tag_3 = TextTag3D(Location=centroid_2, Text=vec2pt.Vector, Size=text_size_5, Justification=7)
vdis = VectorDisplay(Anchor=workpoint_5, Vector=vec2pt.Vector)

# ----
manual_mesh = Geometry(<mesh referenced from the Rhino model>)
subterrain_makemesh = SubterrainMakeMesh(
    overridemesh=manual_mesh,
    mode=output,
    polygon=subterrain_offset.polygon_2,
    corners=subterrain_offset.corners_4,
    midpts=subterrain_offset.midpts_4,
    centroid=subterrain_init.centroid_4,
    subdivlevel=subdivisions)  # -> mesh_2, meshedges_2, meshvertices_2, cornerspts_2, boundarycrv_2

flat_mesh_corners = Data(subterrain_makemesh.cornerspts_2)
text_size_6 = Data(text_size)
points = PointList(Points=flat_mesh_corners, Size=text_size_6)

meshvertices = Data(subterrain_makemesh.meshvertices_2)
meshedges = Data(subterrain_makemesh.meshedges_2)

workpoint_6 = Point(workpoint_3)
text_size_7 = Data(text_size)
tag_4 = TextTag3D(Location=workpoint_6, Text="WP", Size=text_size_7, Justification=7)

gallery_5 = ImageGallery(CycleDelay=30, Randomize=False, UseLocalImages=True, UseRemoteImages=True)

offset = Slider(-0.249, range=-1..0)
tension = Slider(0.797, range=0..1)
floorheight = Slider(0.25, range=0..1)

subterrain_fitmesh = SubterrainFitMesh(
    tension=tension,
    offset=offset,
    boundarycrv=subterrain_makemesh.boundarycrv_2,
    mesh=subterrain_makemesh.mesh_2,
    simulationtoggle=Toggle(False),
    floorheight=floorheight)  # -> mesh_5, cornerpts_2, meshedges_2, meshvertices_2, boundarycrv_4

centroid_3 = Data(subterrain_init.centroid_4)
mesh_corners = Data(subterrain_fitmesh.cornerpts_2)

vec2pt_2 = Vector2Pt(PointA=centroid_3, PointB=mesh_corners, Unitize=False)  # -> Vector, Length
text_size_8 = Data(coordinate_text_size)
vdis_2 = VectorDisplay(Anchor=centroid_3, Vector=vec2pt_2.Vector)
tag_5 = TextTag3D(Location=mesh_corners, Text=vec2pt_2.Vector, Size=text_size_8, Colour=RGB(0, 0, 0), Justification=7)

offsetcorners = Data(subterrain_offset.corners_4)
offsetmidpts = Data(subterrain_offset.midpts_4)
centroid_4 = Data(subterrain_init.centroid_4)
corners_3 = Data(subterrain_init.corners_3)
midpts = Data(subterrain_init.midpts_3)

offset_midpts = Data(offsetmidpts)

boundarycrv = Data(subterrain_fitmesh.boundarycrv_4)

offset_corners = Data(offsetcorners)

offset_corners_2 = Data(offsetcorners)
centroid_5 = Data(centroid_4)

offset_corners_3 = Data(offsetcorners)
corners_4 = Data(corners_3)

offset_midpts_2 = Data(offsetmidpts)
midpts_2 = Data(midpts)

lng_2 = ListLength(List=offset_midpts)
series_2 = Series(Start=0, Step=1, Count=lng_2)
int_2 = Integer(series_2)
concat_2 = Concatenate(FragmentA="MP", FragmentB=int_2)
text_size_9 = Data(text_size)
tag_6 = TextTag3D(Location=offset_midpts, Text=concat_2, Size=text_size_9, Justification=7)

lng_3 = ListLength(List=offset_corners)
series_3 = Series(Start=0, Step=1, Count=lng_3)
int_3 = Integer(series_3)
concat_3 = Concatenate(FragmentA="CP", FragmentB=int_3)
text_size_10 = Data(text_size)
tag_7 = TextTag3D(Location=offset_corners, Text=concat_3, Size=text_size_10, Justification=7)

dimension_text_size_2 = Data(dimension_text_size)
ln = Line(StartPoint=corners_4, EndPoint=offset_corners_3)
lineardim = LinearDimension(Line=ln, PointA=corners_4, PointB=offset_corners_3, Text="{0:0.00}", Size=dimension_text_size_2)

vec2pt_3 = Vector2Pt(PointA=centroid_5, PointB=offset_corners_2, Unitize=False)  # -> Vector, Length
text_size_11 = Data(coordinate_text_size)
tag_8 = TextTag3D(Location=offset_corners_2, Text=vec2pt_3.Vector, Size=text_size_11, Justification=7)
vdis_3 = VectorDisplay(Anchor=centroid_5, Vector=vec2pt_3.Vector)

ln_2 = Line(StartPoint=midpts_2, EndPoint=offset_midpts_2)
dimension_text_size_3 = Data(dimension_text_size)
lineardim_2 = LinearDimension(Line=ln_2, PointA=midpts_2, PointB=offset_midpts_2, Text="{0:0.00}", Size=dimension_text_size_3)

gallery_6 = ImageGallery(
    CycleDelay=30,
    Randomize=False,
    UseLocalImages=True,
    UseRemoteImages=True,
    RemoteUrl="E:\mydocs\dat\grasshopper\components\subterrain\data\mass.jpg")

distributedload = Slider(158.144, range=0..1000)
vertical_stretch = Slider(1.6, range=0..3)

mesh_corners_2 = Data(subterrain_fitmesh.cornerpts_2)
selected_pts = Point()
anchor_pts = Point(mesh_corners_2)

curvepulls_2 = Data(curvepulls)
subterrain_inflate = SubterrainInflate(
    mesh=subterrain_fitmesh.mesh_5,
    meshedges=subterrain_fitmesh.meshedges_2,
    meshvertices=subterrain_fitmesh.meshvertices_2,
    anchorpts=anchor_pts,
    curvepulls=curvepulls_2,
    distributedload=distributedload,
    simulationtoggle=Toggle(False),
    verticalstretch=vertical_stretch,
    bottommesh=subterrain_fitmesh.mesh_5)  # -> mesh_4, meshcorners_2, meshedges_4, meshvertices_4, closedmesh_2

relaxed_vertices = Data(subterrain_inflate.meshvertices_4)
centroid_6 = Data(subterrain_init.centroid_4)

vec2pt_4 = Vector2Pt(PointA=centroid_6, PointB=relaxed_vertices, Unitize=False)  # -> Vector, Length
tag_9 = TextTag3D(Location=relaxed_vertices, Text=vec2pt_4.Vector, Size=text_size_2, Justification=7)

meshvertices_2 = Data(subterrain_inflate.meshvertices_4)
meshcorners = Data(subterrain_inflate.meshcorners_2)
closedmesh = Data(subterrain_inflate.closedmesh_2)
meshedges_2 = Data(subterrain_inflate.meshedges_4)
mesh = Data(subterrain_inflate.mesh_4)

# ==== cluster SubterrainInit
polygon = ClusterInput()
polygon_2 = Curve(polygon)

explode = Explode(Curve=polygon_2, Recursive=True)  # -> Segments, Vertices
len = Length(Curve=explode.Segments)
division = Division(A=len, B=2)
eval = EvaluateCurve(Curve=explode.Segments, Parameter=division)  # -> Point, Tangent, Angle

cp = ControlPoints(Curve=polygon_2)  # -> Points, Weights, Knots
pcen = PolygonCenter(Polyline=polygon_2)  # -> CenterV, CenterE, CenterA
cull_i = CullIndex(List=cp.Points, Indices=0, Wrap=True)

segments = Data(explode.Segments)

centroid = Data(pcen.CenterA)
corners = Data(cull_i)
midpts = Data(eval.Point)

centroid_2 = Data(centroid)
centroid_3 = Data(centroid)
corners_2 = Data(corners)
midpts_2 = Data(midpts)
vec2pt = Vector2Pt(PointA=centroid_3, PointB=midpts_2, Unitize=False)  # -> Vector, Length
vec2pt_2 = Vector2Pt(PointA=centroid_2, PointB=corners_2, Unitize=False)  # -> Vector, Length

rp2cp = Data(vec2pt_2.Vector)
rp2mp = Data(vec2pt.Vector)

midpts_3 = ClusterOutput(midpts)
corners_3 = ClusterOutput(corners)
centroid_4 = ClusterOutput(centroid)
rp2cp_2 = ClusterOutput(rp2cp)
rp2mp_2 = ClusterOutput(rp2mp)

# ==== cluster SubterrainOffset
corneroffsets = ClusterInput()
midptoffsets = ClusterInput()
rp2cp = ClusterInput()
corners = ClusterInput()
midpts = ClusterInput()
rp2mp = ClusterInput()

corneroffsets_2 = Data(corneroffsets)
midptoffsets_2 = Data(midptoffsets)
corners_2 = Data(corners)
midpts_2 = Data(midpts)
rp2cp_2 = Data(rp2cp)
rp2mp_2 = Data(rp2mp)

rev = Reverse(Vector=rp2cp_2)
amp = Amplitude(Vector=rev, Amplitude=corneroffsets_2)
move = Move(Geometry=corners_2, Motion=amp)  # -> Geometry, Transform

rev_2 = Reverse(Vector=rp2mp_2)
amp_2 = Amplitude(Vector=rev_2, Amplitude=midptoffsets_2)
move_2 = Move(Geometry=midpts_2, Motion=amp_2)  # -> Geometry, Transform

offset_corners = Data(move.Geometry)
offset_midpts = Data(move_2.Geometry)

weave = Weave(Pattern=[0, 1], Stream0=offset_midpts, Stream1=offset_corners, NullGaps=False)
pline = PolyLine(Vertices=weave, Closed=True)

corners_3 = Data(move.Geometry)
polygon = Data(pline)
midpts_3 = Data(move_2.Geometry)

midpts_4 = ClusterOutput(midpts_3)
corners_4 = ClusterOutput(corners_3)
polygon_2 = ClusterOutput(polygon)

# ==== cluster SubterrainMakeMesh
polygon = ClusterInput()
corners = ClusterInput()
midpts = ClusterInput()
centroid = ClusterInput()
overridemesh = ClusterInput()
subdivlevel = ClusterInput()
mode = ClusterInput()

polygon_2 = Data(polygon)
subdivlevel_2 = Data(subdivlevel)
centroid_2 = Data(centroid)
corners_2 = Data(corners)
midpts_2 = Data(midpts)

overridemesh_2 = Data(overridemesh)
mode_2 = Data(mode)

weave = Weave(Pattern=[0, 1], Stream0=corners_2, Stream1=midpts_2, NullGaps=False)
ln = Line(StartPoint=weave, EndPoint=centroid_2)
explode = Explode(Curve=polygon_2, Recursive=True)  # -> Segments, Vertices
merge = Merge(Data1=flatten(explode.Segments), Data2=flatten(ln))
wbweave = WeaverbirdsMeshFromLinesWeaveBack(Lines=merge, MaximumValence=4)
wbcatmullclark = WeaverbirdsCatmullClarkSubdivision(MeshCurves=wbweave, Level=subdivlevel_2, SmoothNakedEdges=1)
wbloop = WeaverbirdsLoopSubdivision(MeshCurves=wbweave, Level=subdivlevel_2, SmoothNakedEdges=1)

ln_2 = Line(StartPoint=corners_2, EndPoint=centroid_2)
explode_2 = Explode(Curve=polygon_2, Recursive=True)  # -> Segments, Vertices
merge_2 = Merge(Data1=flatten(explode_2.Segments), Data2=flatten(ln_2))
wbweave_2 = WeaverbirdsMeshFromLinesWeaveBack(Lines=merge_2, MaximumValence=4)
wbcatmullclark_2 = WeaverbirdsCatmullClarkSubdivision(MeshCurves=wbweave_2, Level=subdivlevel_2, SmoothNakedEdges=1)
wbloop_2 = WeaverbirdsLoopSubdivision(MeshCurves=wbweave_2, Level=subdivlevel_2, SmoothNakedEdges=1)

ln_3 = Line(StartPoint=midpts_2, EndPoint=centroid_2)
explode_3 = Explode(Curve=polygon_2, Recursive=True)  # -> Segments, Vertices
merge_3 = Merge(Data1=flatten(explode_3.Segments), Data2=flatten(ln_3))
wbweave_3 = WeaverbirdsMeshFromLinesWeaveBack(Lines=merge_3, MaximumValence=4)
wbcatmullclark_3 = WeaverbirdsCatmullClarkSubdivision(MeshCurves=wbweave_3, Level=subdivlevel_2, SmoothNakedEdges=1)
wbloop_3 = WeaverbirdsLoopSubdivision(MeshCurves=wbweave_3, Level=subdivlevel_2, SmoothNakedEdges=1)

mjoin = MeshJoin(Meshes=overridemesh_2)
wbunify = WeaverbirdsUnifyFaceWindings(MeshCurves=mjoin)
wbcatmullclark_4 = WeaverbirdsCatmullClarkSubdivision(MeshCurves=wbunify, Level=subdivlevel_2, SmoothNakedEdges=1)
weld = WeldMesh(Mesh=mjoin, Angle=0)
wbloop_4 = WeaverbirdsLoopSubdivision(MeshCurves=wbunify, Level=subdivlevel_2, SmoothNakedEdges=1)

# ---- group: option 1
furthur_subdiv_quad_mesh = Data(wbcatmullclark_4)
furthur_subdiv_tri_mesh = Data(wbloop_4)
manual_mesh = Mesh(wbunify)

# ---- group: option 2
subdivided_quad_mesh = Data(wbcatmullclark)
subdivided_tri_mesh = Data(wbloop)
simple_mesh = Mesh(wbweave)

subdivided_quad_mesh_2 = Data(wbcatmullclark_2)
subdivided_tri_mesh_2 = Data(wbloop_2)
simple_mesh_2 = Mesh(wbweave_2)

subdivided_quad_mesh_3 = Data(wbcatmullclark_3)
subdivided_tri_mesh_3 = Data(wbloop_3)
simple_mesh_3 = Mesh(wbweave_3)

# ----
mode_3 = Data(mode_2)
p_n_c = PickNChoose(
    Pattern=mode_3,
    Stream0=manual_mesh,
    Stream1=furthur_subdiv_quad_mesh,
    Stream2=furthur_subdiv_tri_mesh,
    Stream3=simple_mesh,
    Stream4=subdivided_quad_mesh,
    Stream5=subdivided_tri_mesh,
    Stream6=simple_mesh_2,
    Stream7=subdivided_quad_mesh_2,
    Stream8=subdivided_tri_mesh_2,
    Stream9=simple_mesh_3,
    Stream10=subdivided_quad_mesh_3,
    Stream11=subdivided_tri_mesh_3)

flat_mesh = Data(p_n_c)

meshcorners = MeshCorners(M=flat_mesh, A=1e-05)
pline = PolyLine(Vertices=meshcorners, Closed=True)

nv = NakedVertices(Mesh=flat_mesh)  # -> ClothedIndex, NakedIndex, ClothedPts, NakedPts
wbvertices = VerticesComponent(Mesh=flat_mesh, Weld=True)
wbedges = MeshEdges(Mesh=flat_mesh)

# ---- group: room shape
boundarycrv = Data(pline)
cornerspts = Data(meshcorners)

# ----
cornerspts_2 = ClusterOutput(cornerspts)
boundarycrv_2 = ClusterOutput(boundarycrv)

# ---- group: topology
meshvertices = Data(wbvertices)
meshedges = Data(wbedges)

# ----
meshvertices_2 = ClusterOutput(meshvertices)
meshedges_2 = ClusterOutput(meshedges)

mesh = Mesh(p_n_c)

mesh_2 = ClusterOutput(mesh)

# ==== cluster SubterrainFitMesh
floorheight = ClusterInput()
mesh = ClusterInput()
offset = ClusterInput()
tension = ClusterInput()
simulationtoggle = ClusterInput()
boundarycrv = ClusterInput()

simulationtoggle_2 = Data(simulationtoggle)
boundarycrv_2 = Data(boundarycrv)
floorheight_2 = Number(floorheight)
tension_2 = Data(tension)
offset_2 = Data(offset)
mesh_2 = Mesh(mesh)

nv = NakedVertices(Mesh=mesh_2)  # -> ClothedIndex, NakedIndex, ClothedPts, NakedPts
offset_3 = Offset(Curve=boundarycrv_2, Distance=offset_2, Plane=PlaneXY(0, 0, 0), Corners=1)
springsfrommesh = SpringsFromMesh(M=mesh_2, stiffness=100, B=tension_2)
boundary = Curve(offset_3)
curvepull = CurvePull(Curve=boundary, Points=nv.NakedPts, Strength=1000)
timer = Timer(TimerInterval=20, Target=kangaroo)
kangaroo = KangarooPhysics(ForceObjects=flatten([springsfrommesh, curvepull]), Settings=null, Geometry=mesh_2, SimulationReset=simulationtoggle_2)  # -> Out, Iterations, ParticlesOut, GeometryOut
mesh_3 = Mesh(kangaroo.GeometryOut)

elevation = Data(floorheight_2)

Z = UnitZ(Factor=1)
amp = Amplitude(Vector=Z, Amplitude=elevation)
move = Move(Geometry=mesh_3, Motion=amp)  # -> Geometry, Transform

displaced_mesh = Data(move.Geometry)

meshcorners = MeshCorners(M=displaced_mesh, A=1e-05)
pline = PolyLine(Vertices=meshcorners, Closed=True)
points = PointList(Points=meshcorners)

nv_2 = NakedVertices(Mesh=displaced_mesh)  # -> ClothedIndex, NakedIndex, ClothedPts, NakedPts
wbvertices = VerticesComponent(Mesh=displaced_mesh, Weld=True)
wbedges = MeshEdges(Mesh=displaced_mesh)

meshedges = Data(wbedges)
meshvertices = Data(wbvertices)
cornerpts = Data(nv_2.NakedPts)

cornerpts_2 = ClusterOutput(cornerpts)
meshvertices_2 = ClusterOutput(meshvertices)
meshedges_2 = ClusterOutput(meshedges)

# ---- group: room shape
boundarycrv_3 = Data(pline)

# ----
boundarycrv_4 = ClusterOutput(boundarycrv_3)

# ---- group: Cell Floor
mesh_4 = Data(move.Geometry)

# ----
mesh_5 = ClusterOutput(mesh_4)

# ==== cluster SubterrainInflate
meshedges = ClusterInput()
meshvertices = ClusterInput()
mesh = ClusterInput()
simulationtoggle = ClusterInput()
distributedload = ClusterInput()
anchorpts = ClusterInput()
curvepulls = ClusterInput()
bottommesh = ClusterInput()
verticalstretch = ClusterInput()

distributedload_2 = Data(distributedload)
simulationtoggle_2 = Data(simulationtoggle)
bottommesh_2 = Data(bottommesh)
verticalstretch_2 = Number(verticalstretch)
curvepulls_2 = Data(curvepulls)
anchorpts_2 = Point(anchorpts)

meshvertices_2 = Data(meshvertices)
meshedges_2 = Data(meshedges)
mesh_2 = Mesh(mesh)

Z = UnitZ(Factor=distributedload_2)
springs = SpringsFromLine(
    Connection=meshedges_2,
    Stiffness=1000,
    Damping=10,
    RestLength=meshedges_2,
    Cutoff=0,
    CompressionFail=0,
    TensileFail=0,
    Plasticity=0)
uforce = UnaryForce(Point=meshvertices_2, Force=Z)
timer = Timer(TimerInterval=1000, Target=kangaroo)
kangaroo = KangarooPhysics(
    ForceObjects=flatten([springs, curvepulls_2, uforce]),
    AnchorPoints=anchorpts_2,
    Settings=null,
    Geometry=mesh_2,
    SimulationReset=simulationtoggle_2)  # -> Out, Iterations, ParticlesOut, GeometryOut
relaxed_mesh = Mesh(kangaroo.GeometryOut)

bottom_mesh = Data(bottommesh_2)

vertical_stretch = Data(verticalstretch_2)

Z_2 = UnitZ(Factor=1)
amp = Amplitude(Vector=Z_2, Amplitude=vertical_stretch)
move = Move(Geometry=kangaroo.GeometryOut, Motion=amp)  # -> Geometry, Transform

displaced_mesh = Data(move.Geometry)

nv = NakedVertices(Mesh=displaced_mesh)  # -> ClothedIndex, NakedIndex, ClothedPts, NakedPts
wbvertices = VerticesComponent(Mesh=displaced_mesh, Weld=True)
wbedges = MeshEdges(Mesh=displaced_mesh)

meshvertices_3 = Data(wbvertices)
meshcorners = Data(nv.NakedPts)
meshedges_3 = Data(wbedges)

meshcorners_2 = ClusterOutput(meshcorners)
meshvertices_4 = ClusterOutput(meshvertices_3)
meshedges_4 = ClusterOutput(meshedges_3)

# ---- group: Cell Top
mesh_3 = Data(move.Geometry)

# ----
mesh_4 = ClusterOutput(mesh_3)

top_mesh = Data(mesh_3)

tsconv = TsConvert(InGeometry=top_mesh)
tsconv_2 = TsConvert(InGeometry=bottom_mesh)
tsdedge = TsDecomposeEdge(InTSpline=tsconv)  # -> OutputAll, OutputNonmanifold, OutputBorder, OutputInner
tsdedge_2 = TsDecomposeEdge(InTSpline=tsconv_2)  # -> OutputAll, OutputNonmanifold, OutputBorder, OutputInner
tsbridge = TsBridge(
    InTSpline0=tsconv,
    Edges0=tsdedge.OutputBorder,
    InTSpline1=tsconv_2,
    Edges1=tsdedge_2.OutputBorder,
    InCurve=<geometry referenced from the Rhino model>,
    Segs=3)

closedmesh = Data(tsbridge)

closedmesh_2 = ClusterOutput(closedmesh)

# ==== cluster MeshCorners: Finds the corners of the boundary of a mesh
M = ClusterInput()
medges = MeshEdges(Mesh=M)  # -> NakedEdges, InteriorEdges, NonManifoldEdges
join = JoinCurves(Curves=medges.NakedEdges, Preserve=False)
explode = Explode(Curve=join, Recursive=True)  # -> simplify(Segments), Vertices
shift = ShiftList(List=explode.Segments, Shift=1, Wrap=True)  # -> simplify(List)
end = EndPoints(Curve=explode.Segments)  # -> Start, End
angle = Angle(VectorA=explode.Segments, VectorB=shift)  # -> Angle, Reflex
A = ClusterInput()
smaller = SmallerThan(FirstNumber=A, SecondNumber=angle.Angle)  # -> SmallerThan, OrEqualTo
cull = CullPattern(List=end.End, CullPattern=smaller.SmallerThan)  # -> flatten(List)
L = ClusterOutput(cull)

# ==== cluster SpringsFromMesh: Turns all edges of a mesh into springs
M = ClusterInput()
medges = MeshEdges(Mesh=M)  # -> NakedEdges, InteriorEdges, NonManifoldEdges
crv = Curve([medges.NakedEdges, medges.InteriorEdges])
B = ClusterInput()
len = Length(Curve=crv)
multiplication = Multiplication(A=len, B=B)
stiffness = ClusterInput()
springs = SpringsFromLine(Connection=crv, Stiffness=stiffness, Damping=10, RestLength=multiplication, UpperCutoff=0, LowerCutoff=0, Plasticity=0)
S = ClusterOutput(springs)
